vi "Main.gviweb"   [LabVIEW NXG 2.0.0]
panel controls:
  "LED_3": bool = TRUE
  "LED_4": bool = TRUE
  "LED_5": bool = TRUE
panel indicators:
  "URL Image": string
  "STN 1 progress": f64
  "STN 2 progress": f64
  "STN 1=3 progress": f64
  "aggregates": T1[]
  "vibe-data": f64[]
types:
  T1 = cluster{"Tester": string, "DUTs Pass": f64, "Drive State": bool}
diagram:
  s1 = 0  # shift register
  s2 = 73  # shift register
  s3 = 33  # shift register
  while {
    Wait(time to wait=250)
    call "get-aggregates.gviweb"() -> (Data Grid=w1)
    $aggregates <- w1
    call "progress-update.gviweb"(Numeric=s1) -> (Radial Progress Bar=w2)
    $"STN 1 progress" <- w2
    call "progress-update.gviweb"(Numeric=s2) -> (Radial Progress Bar=w3)
    $"STN 2 progress" <- w3
    call "get-vibe-data.gviweb"() -> (Graph=w4)
    $"vibe-data" <- w4
    call "progress-update.gviweb"(Numeric=s3) -> (Radial Progress Bar=w5)
    $"STN 1=3 progress" <- w5
    next s1 = w2
    next s2 = w3
    next s3 = w5
    stop if FALSE
  }
