vi "get-tags.gviweb"   [LabVIEW NXG 2.0.0]
inputs:
  "client handle out": "Client Handle.gtype"
  "error out_2": error
  "resulting string": string
  "initialized array": f64[][]
  "value_2": i32
outputs:
  "client handle": "Client Handle.gtype"
  "error in": error
  "Graph": f64[][]
types:
  "Client Handle.gtype" = u32
uses:
  NI::HTTP::GET.gvi
diagram:
  call "GET.gvi"(client handle=$"client handle out", url=$"resulting string", error in=$"error out_2") -> (client handle out=w1, body=w2, error out=w3)
  $"client handle" <- w1
  Match Pattern(regular expression="\\[.*\\]", string=w2) -> (match substring=w4)
  Unflatten From JSON(JSON string=w4, type and defaults=f64[] []) -> (value=w5)
  Replace Array Subset(inArray=$"initialized array", index=_, index=$value_2, new=w5) -> w6
  $Graph <- w6
  $"error in" <- w3
