vi "get-vibe-data.gviweb"   [LabVIEW NXG 2.0.0]
outputs:
  "Graph": f64[]
panel indicators:
  "headers": string
uses:
  NI::HTTP::GET.gvi
diagram:
  call "GET.gvi"(url="http://cirrostratus:8080/ws/vibe-data") -> (headers=w1, body=w2)
  $headers <- w1
  Unflatten From JSON(JSON string=w2, type and defaults=f64[] []) -> (value=w3)
  $Graph <- w3
