vi "progress-update.gviweb"   [LabVIEW NXG 2.0.0]
inputs:
  "Numeric": f64
outputs:
  "Radial Progress Bar": f64
diagram:
  Is Equal(x=$Numeric, y=100) -> w1
  Select(s=w1, t=0, f=$Numeric) -> w2
  Increment(x=w2) -> w3
  $"Radial Progress Bar" <- w3
